# Grasshopper definition OpenFoilLab.gh (Grasshopper 1.0.7)
# plug-ins: Anemone, LunchBox

# ----
# Global frame of the foil :
# Define the movement of the foil
# (simple translation or rotation around a point or guide curve between two bearings ...)
number_slider = Slider(0, range=0..100)
rad = Radians(Degrees=number_slider)
pt = Point(Point(0, 0, 2560))
# Global Frame
crv = Curve(<curve referenced from the Rhino model>)
X = UnitX(Factor=1)
rot3d = Rotate3D(Geometry=crv, Angle=rad, Center=pt, Axis=X)  # -> Geometry, Transform

# ----
# Choice of section type
# Select txt file of points, watch spacing with commas
section_path = FilePath("C:\Users\bguth\Documents\DesEng4\01 Masters Project\FOIL DESIGN\Grasshopper\NACA 65 412.txt")
separateur = Text(",")
coords = ImportCoordinates(File=section_path, Separator=separateur, XIndex=0, YIndex=1, ZIndex=2)
origin_position = Origin_position(V=coords, D=3)
base_profile_points = Point(origin_position)

panel = Panel(coords)

# ----
# Number of Sections
# Chord length (mm)
# Direction of sections
number_slider_2 = Slider(1, range=0..100)
# Section Import
number_slider_3 = Slider(3, range=0..3)
# Inputs
crv_2 = Curve(<curve referenced from the Rhino model>)
chord = Number(Slider(250, range=0..1000))

# ----
# Spanwise Parameters
# Double click each cluster to edit,
# then update sections below
pframes = PerpFrames(Curve=crv_2, Count=number_slider_2, Align=True)  # -> Frames, Parameters
deplane = DeconstructPlane(Plane=pframes.Frames)  # -> Origin, XAxis, YAxis, ZAxis
twist = Twist(crv=crv_2, curve_pts=pframes.Parameters)
camber = Camber(crv=crv_2, curve_pts=pframes.Parameters)
tickness = Tickness(crv=crv_2, curve_pts=pframes.Parameters)
chord_end = Chord_end(G=deplane.Origin, chord=chord, crv=crv_2, y=pframes.Parameters)  # -> G_2, R, chord_2
rotate_planes = Rotate_planes(pln=pframes.Frames, i=number_slider_3)

# ----
# Update Sections
# Section Profiling
# Generates the set of sections after pressing the button.
# Run every time a modification is made to chord, thickness or camber.
button = Button()
loop_start = LoopStart(N=number_slider_2, T=button)  # -> port, Counter, Data, Data_2
item = ListItem(List=chord_end.chord_2, Index=loop_start.Counter, Wrap=True)
item_2 = ListItem(List=tickness, Index=loop_start.Counter, Wrap=True)
item_3 = ListItem(List=camber, Index=loop_start.Counter, Wrap=True)
panel_2 = Panel(loop_start.Counter)
new_profile = New_profile(V=base_profile_points, max_tickness=item_2, N=Slider(82, range=0..1000), new_camber=item_3, scaling=item)  # -> section, le_point, lift_center, chord, lift_vector
loop_end = LoopEnd(
    port=loop_start.port,
    Exit=False,
    Data=[new_profile.le_point, new_profile.section],
    Data_2=[new_profile.chord, new_profile.lift_vector],
    TimeOutVal=0,
    pausedState=False,
    state="Constant & Record")  # -> flatten(D0), flatten(D1)
dispatch = Dispatch(List=loop_end.D0, DispatchPattern=[True, False])  # -> Le_points, Sections

# ----
# Checks
# Shaft angle: adjusts the distance of the foil from the guide curve,
# e.g. to angle the tip of the foil backwards
number_slider_4 = Slider(1, range=0..30)
shaft_angle = Shaft_angle(pt=deplane.Origin, D=number_slider_4)
addition = Addition(A=shaft_angle, B=chord_end.R)

# ----
# If foil is projected forwards, change from -1 to 1.
number_slider_5 = Slider(-1, range=-1..1)
X_2 = UnitX(Factor=addition)
multiplication = Multiplication(A=number_slider_5, B=X_2)

mirror = Mirror(Geometry=dispatch.Sections, Plane=PlaneYZ(0, 0, 0))  # -> Geometry, Transform
panel_3 = Panel(new_profile.chord)
crv_3 = Curve(mirror.Geometry)
orient = Orient(Geometry=crv_3, Source=PlaneXY(0, 0, 0), Target=rotate_planes)  # -> Sections_on_plane, Transform
move = Move(Geometry=orient.Sections_on_plane, Motion=multiplication)  # -> Geometry, Transform

# ----
# Select section to mesh
number_slider_6 = Slider(1, range=0..10)
# Meshing
mesh = Mesh(orient.Sections_on_plane)
python = GhPythonScript(x=mesh, y=number_slider_6)  # -> out, a; inputs x: list of Mesh
# ---------- python: Python ----------
import rhinoscriptsyntax as rs

a = x[int(y)]

print(x[int(y)])
# ---------- end python ----------
panel_4 = Panel(python.a)
number_of_nodes = Slider(4000, range=0..10000)
qrmesh = QuadRemesh(Mesh=python.a, Guides=orient.Sections_on_plane, Settings=number_of_nodes)

# ----
# Generate 3D
# Creating the surface:
# Activate (double-click) to bake the section.
# Deactivate before closing file.
toggle = BooleanToggle(True)
python_2 = GhPythonScript(x=toggle, y=move.Geometry)  # -> out, a
# ---------- python_2: Python ----------
import rhinoscriptsyntax as rs
if x == True :
    a = y
# ---------- end python_2 ----------
fitloft = FitLoft(Curves=python_2.a, CountU=Slider(500, range=0..1000), DegreeU=Slider(2, range=0..10), DegreeV=Slider(3, range=0..10))

# ----
# Connect to Mesh
relay = Relay()
mesh_2 = Mesh(relay)
demesh = DeconstructMesh(Mesh=mesh_2)  # -> Vertices, Faces, Colours, Normals
panel_5 = Panel(demesh.Vertices)
panel_6 = Panel(demesh.Faces)

# ----
# XQUAD4
# XTRIA3
python_3 = GhPythonScript(x=panel_6)  # -> out, a, input_data, output_data, count; inputs x: list
# ---------- python_3: Python ----------
import rhinoscriptsyntax as rs

# Fixed values
prefix = "XTRIA3"
suffix = "1,0.0,0.0,0.0"

# Output list
output = []

# Parse the input data into a list of tuples
input_data = []
for line in x:
    if line.strip().startswith('Q'):
        continue  # Skip this line and move to the next iteration
    numbers = line.strip('T').strip('{}').split(';')
    # Convert each number to float and store as a tuple
    incremented_numbers = tuple(map(lambda num: float(num) + 1, numbers))
    input_data.append(incremented_numbers)

# Prepare the output list with a header
output_data = []

# Process each tuple in the input list
for index, (a, b, c) in enumerate(input_data, start=1):
    # Format each line according to the specified output format
    formatted_line = "{},{},{},{},{},{}".format(prefix, index, int(a), int(b), int(c), suffix)
    output_data.append(formatted_line)

# Print the number of elements
count = 0
for item in x:
    count += 1
# ---------- end python_3 ----------
python_4 = GhPythonScript(x=panel_6)  # -> out, a, input_data, output_data, count; inputs x: list
# ---------- python_4: Python ----------
import rhinoscriptsyntax as rs

# Fixed values
prefix = "XQUAD4"
suffix = "1,0.0,0.0,0.0"

# Output list
output = []

# Parse the input data into a list of tuples
input_data = []
for line in x:
    if line.strip().startswith('T'):
        continue  # Skip this line and move to the next iteration
    numbers = line.strip('Q').strip('{}').split(';')
    # Convert each number to float and store as a tuple
    incremented_numbers = tuple(map(lambda num: float(num) + 1, numbers))
    input_data.append(incremented_numbers)

# Prepare the output list with a header
output_data = []

# Process each tuple in the input list
for index, (a, b, c, d) in enumerate(input_data, start=1):
    # Format each line according to the specified output format
    formatted_line = "{},{},{},{},{},{},{}".format(prefix, index, int(a), int(b), int(c), int(d), suffix)
    output_data.append(formatted_line)


# Print the number of elements
count = 0
for item in x:
    count += 1
# ---------- end python_4 ----------
panel_7 = Panel(python_3.count)
panel_8 = Panel(python_4.count)
panel_9 = Panel(python_4.output_data)
panel_10 = Panel(python_3.output_data)

# ----
# SECTION FROM ELEMENTS
python_5 = GhPythonScript(count=panel_7)  # -> out, numbers_str
# ---------- python_5: Python ----------
import rhinoscriptsyntax as rs

# Start number
start = 1
# End number
end = int(count)

# Create a list of numbers from start to end
numbers = list(range(start, end + 1))

# Convert the list of numbers to a string separated by commas
numbers_str = ','.join(map(str, numbers))
# ---------- end python_5 ----------
panel_11 = Panel(python_5.numbers_str)

panel_12 = Panel("-------------imported value-------------")
path = FilePath("C:\Users\bguth\Desktop\Master\XFLR5-AUTOMATION-main\Input_textfile\blg20_hydro_analysis.txt")
# Export to XFLR5 - automation
path_2 = FilePath("C:\Users\bguth\Desktop\Master\XFLR5-AUTOMATION-main\Input_textfile\blg20_input.txt")
python_6 = GhPythonScript(
    x=path_2,
    y=path,
    input1=panel_12,
    input2=panel_12,
    input3=panel_12,
    input4=panel_12,
    input5=panel_12,
    input6=panel_12,
    input7=panel_12,
    input8=panel_12)  # -> out, output, contents
# ---------- python_6: Python ----------
import rhinoscriptsyntax as rs
input_path = x
output_path = y



# Open the file and read its contents
with open(input_path, 'r') as file:
    contents = file.readlines()  # Read all lines into a list

# Modify the contents directly in the list
for i, line in enumerate(contents):
    if "INPUT1" in line:
        contents[i] = line.replace("INPUT1", input1)  # Replace directly in the original list

    elif "INPUT2" in line:
        contents[i] = line.replace("INPUT2", input2)  # Replace directly in the original list

    elif "INPUT3" in line:
        contents[i] = line.replace("INPUT3", input3)  # Replace directly in the original list

    elif "INPUT4" in line:
        contents[i] = line.replace("INPUT4", input4)  # Replace directly in the original list

    elif "INPUT5" in line:
        contents[i] = line.replace("INPUT5", input5)  # Replace directly in the original list

    elif "INPUT6" in line:
        contents[i] = line.replace("INPUT6", input6)  # Replace directly in the original list

    elif "INPUT7" in line:
        contents[i] = line.replace("INPUT7", input7)  # Replace directly in the original list

    elif "INPUT8" in line:
        contents[i] = line.replace("INPUT8", input8)  # Replace directly in the original list



# Write the modified contents back to a file
with open(output_path, 'w') as file:
    file.writelines(contents)  # Write all lines to the file
# ---------- end python_6 ----------
panel_13 = Panel(python_6.contents)

# ----
# Export to AeroComBAT
# NODES
python_7 = GhPythonScript(x=panel_5)  # -> flatten(out), input, b; inputs x: list
# ---------- python_7: Python ----------
import rhinoscriptsyntax as rs


# Parse the input data into a list of tuples
input_data = []
for line in x:
    # Remove the curly braces and split by comma
    x, y, z = map(float, line.strip('{}').split(','))
    input_data.append((x, y, z))

# Prepare the output list with a header
output_data = ["XNODE, ID, X, Y"]

# Process each tuple in the input list
for index, (x, y, z) in enumerate(input_data, start=1):
    # Format each line according to the specified output format
    formatted_line = "XNODE, {}, {}, {}".format(index, x, y)
    output_data.append(formatted_line)

# Print the output data
for line in output_data[1:]:
    print(line)
# ---------- end python_7 ----------
panel_14 = Panel(python_7.out)

# ----
# Number of key points
# Number of points with conditions
# Number of different cross sections
# Number of frames
# Number of members with distributed loadings
# Number of functions
# Number of time functions
# Number of initial twists
number_slider_7 = Slider(4, range=0..20)
number_slider_8 = Slider(0, range=0..20)

# ----
# Export to Beam Analysis
# Type of analysis
# Iterations
# Steps
number_slider_9 = Slider(0, range=0..3)

# ----
# Settings
# Dynamic Study
# Counts
# Number of Members
# Straight Bar Example
# List of Key Points
# Fix first point
# blank next points
# stiffness matrix
# distributed loads per member
# function def
# start and end time
# function block
# Select stiffness matrix
# (AeroComBAT output)
# start time
# end time
number_slider_10 = Slider(0, range=0..10)
# Foil simplification for XFLR and GEBT
# (straight-member definition)
# List of Members
number_slider_11 = Slider(1, range=0..10)
file = ReadFile(File="C:\Users\bguth\Desktop\Master\GEBT\stiffness from AeroComBAT\stiffness_matrix.csv", PerLineParse=True)
int = Integer(number_slider_2)
panel_15 = Panel(file)
addition_2 = Addition(A=int, B=1)
int_2 = Integer(addition_2)
subtraction = Subtraction(A=int_2, B=1)
python_8 = GhPythonScript(x=file)  # -> flatten(out), a
# ---------- python_8: Python ----------
import rhinoscriptsyntax as rs

def process_data(input_text):
    output = []
    section_number = 0  # Keep track of the section number
    lines = input_text.split('\n')  # Split the input text into lines
    for line in lines:
        if "Section" in line:
            section_number += 1  # Increment section number when a new section is found
            if section_number > 1:
                output.append("\n")  # Add a newline to separate sections in the output
            output.append("{}\n".format(section_number))  # Append the section number followed by a newline
        elif line.strip() and not line.startswith("Section"):  # Ignore empty lines and section headers
            # Format the matrix row: replace commas with spaces
            formatted_line = ' '.join(line.split(','))
            output.append(formatted_line + '\n')
    return ''.join(output)  # Join all parts to form the final output string


input_data = x

# Process the data
output_data = process_data(input_data)
print(output_data)
# ---------- end python_8 ----------
python_9 = GhPythonScript(x=number_slider_10, y=number_slider_11)  # -> out, a
# ---------- python_9: Python ----------
import rhinoscriptsyntax as rs

a = str(int(x)) + " " + str(int(y))

print(a)
# ---------- end python_9 ----------
python_10 = GhPythonScript(x=number_slider_9, y=Slider(99, range=0..200), z=Slider(10, range=0..20))  # -> out, a
# ---------- python_10: Python ----------
import rhinoscriptsyntax as rs

out = str(int(x)) + " " + str(int(y)) + " " + str(int(z))

print(out)
# ---------- end python_10 ----------
txt = Text(flatten(file))
txt_2 = Text(number_slider_8)
python_11 = GhPythonScript(
    n_keyPoints=addition_2,
    n_members=subtraction,
    n_pointConditions=number_slider_8,
    n_crossSections=number_slider_7,
    n_frames=Slider(1, range=0..20),
    n_distLoading=Slider(3, range=0..20),
    n_functions=Slider(1, range=0..20),
    n_timeFunctions=Slider(1, range=0..20),
    n_twists=Slider(0, range=0..20))  # -> out, a
# ---------- python_11: Python ----------
import rhinoscriptsyntax as rs

out = str(int(n_keyPoints)) + " " + str(int(n_members)) + " " + str(int(n_pointConditions)) + " " + str(int(n_crossSections)) + " " + str(int(n_frames)) + " " + str(int(n_distLoading))

print(out) + " " + str(int(n_functions)) + " " + str(int(n_timeFunctions)) + " " + str(int(n_twists))
# ---------- end python_11 ----------
python_12 = GhPythonScript(x=deplane.Origin)  # -> out, output; inputs x: list
# ---------- python_12: Python ----------
import rhinoscriptsyntax as rs




input_data = [
    "{0, 0, 0}",
    "{0, 770, 0}",
    "{0, 1540, 0}",
    "{0, 2310, 0}"]

# Process and output the transformation
index = 0  # Initialize line counter

# Output list
output = []

for line in x:
    index += 1
    # Remove curly braces and extra spaces, then split by commas
    numbers = line.split(',')
    # Format each number to float and prepare output line
    output_line = str(index) + ' ' + ' '.join(format(float(num), '.1f') for num in numbers)
    output.append(output_line)
# ---------- end python_12 ----------
python_13 = GhPythonScript(x=subtraction)  # -> out, output
# ---------- python_13: Python ----------
import rhinoscriptsyntax as rs


# Output list
output = []

print(x)

mem = list(range(1, int(x)+1))
print(mem)


for line in mem:
    output_string = str(line + 1 ) +"\n7 8 9 10 11 12\n0 0 0 0 0 0 \n0 0 0 0 0 0 \n0 0 0 0 0 0"
    output.append(output_string)
# ---------- end python_13 ----------
panel_16 = Panel(python_12.output)
panel_17 = Panel(python_11.out)
panel_18 = Panel(python_8.out)
panel_19 = Panel(python_13.output)
panel_20 = Panel("""1
7 8 9 10 11 12
0 0 0 0 0 0 
0 0 0 0 0 0
0 0 0 0 0 0""")
panel_21 = Panel("""1 
0  
0 1   

2     
0 0   
1 1    """)
panel_22 = Panel("""1
0 0 1 0 0 0  
0 0 1 0 0 0
0 0 1 0 0 0
0 0 1 0 0 0

2
0 0 1 0 0 0  
0 0 1 0 0 0
0 0 1 0 0 0
0 0 1 0 0 0""")
panel_23 = Panel(python_9.out)
panel_24 = Panel("""1 
1000 0 0 0 0 0 """)
panel_25 = Panel("""0 0 0
0 0 0
0 0 0
0 0 0""")
panel_26 = Panel(python_10.out)
python_14 = GhPythonScript(
    a=panel_26,
    b=panel_25,
    c=panel_17,
    d=panel_16,
    e=panel_20,
    f=panel_19,
    g=panel_18,
    h=panel_22,
    x=panel_24,
    j=panel_23,
    k=panel_21)  # -> out, output; inputs a: list, b: list, c: list, d: list, e: list, f: list, g: list, h: list, x: list, j: list, k: list
# ---------- python_14: Python ----------
import rhinoscriptsyntax as rs

output = []
print(x)

for i in a:
    output.append(i)
for i in b:
    output.append(i)
for i in c:
    output.append(i)
for i in d:
    output.append(i)
for i in e:
    output.append(i)
for i in f:
    output.append(i)
for i in g:
    output.append(i)

output.append(h[0])

for i in x:
    output.append(i)
for i in j:
    output.append(i)
for i in k:
    output.append(i)


print(output)
# ---------- end python_14 ----------
panel_27 = Panel(python_14.output)
path_3 = FilePath("C:\Users\bguth\Desktop\Master\GEBT\AeroComBAT outputs\output_for_GEBT.csv")
excelwrite = ExcelWrite(WriteExcelData=Button(), WorkbookPath=path_3, WorksheetName="Sheet1", Data=flatten(panel_27), ClearSheet=False)
panel_28 = Panel(excelwrite)

# ----
# ID
# start point ID
# end point ID
# cross section ID start
# cross section ID end
# frame ID of starting member
# (0 means same as global frame)
# division
# twist ID
input = ClusterInput()
input_2 = ClusterInput()
input_3 = ClusterInput()
input_4 = ClusterInput()
input_5 = ClusterInput()
input_6 = ClusterInput()
input_7 = ClusterInput()
number_slider_12 = Slider(2, range=0..20)

python_15 = GhPythonScript()  # -> out, a
# ---------- python_15: Python ----------
import rhinoscriptsyntax as rs


# List to store the generated strings
result_list = []

# Generating n strings each containing 8 numbers
for i in range(no_members):


    # Concatenating the numbers into a single string
    result_string = str(num1) + str(num2) + str(num3) + str(num4) + str(num5) + str(num6) + str(num7) + str(num8)
    
    # Adding the concatenated string to the list
    result_list.append(result_string)

# Printing each string on a new line
for string in result_list:
    print(string)
# ---------- end python_15 ----------

# ==== cluster Tickness
crv = ClusterInput()
crv_2 = Curve(crv)
tickness2 = Slider(0.15, range=0..0.5)
tickness1 = Slider(0.15, range=0..0.5)
tickness3 = Slider(0.15, range=0..0.5)
curvepoint = PointOnCurve(crv_2, parameter=1)
point_on_curve = PointOnCurve(crv_2, parameter=0)
point_on_curve_2 = PointOnCurve(crv_2, parameter=1)
point_on_curve_3 = PointOnCurve(crv_2, parameter=1)
point3 = Point(point_on_curve_3)
point1 = Point(point_on_curve)
point2 = Point(point_on_curve_2)
point4 = Point(curvepoint)
num = Number([tickness1, tickness2, tickness3])
crv_cp = CurveClosestPoint(Point=[point1, point2, point3, point4], Curve=crv_2)  # -> Point, Parameter, Distance
curve_pts = ClusterInput()
python = GhPythonScript(pt_transi=crv_cp.Parameter, curve_pts=curve_pts, tickness=num)  # -> out, tick; inputs pt_transi: list, curve_pts: list, tickness: list
# ---------- python: Python ----------
import rhinoscriptsyntax as rs
tick = []
length = len(curve_pts)
ind = 0
curve_domain = [curve_pts[0], curve_pts[-1]]
curve_end = curve_pts[-1]

def linear(x1, x2, y1, y2, x):
    coef = (y2-y1)/(x2-x1)
    return y1 +coef*(x-x1)

interval1 = [pt_transi[0], pt_transi[1]]
interval2 = [pt_transi[2], pt_transi[3]]
if len(tickness)==1:
    for i in curve_pts:
        tick.append(tickness[0])
else:
    for i in range (0, length) :
        if curve_pts[i]<=interval1[0]:
            print(tickness[0])
            tick.append(tickness[0])
        elif interval1[0]<curve_pts[i]<interval1[1] :
            a = linear(interval1[0], interval1[1], tickness[0], tickness[1], curve_pts[i])
            print(a)
            tick.append(a)
        elif interval1[1]<=curve_pts[i]<=interval2[0] :
            tick.append(tickness[1])
        elif interval2[0]<curve_pts[i]<interval2[1] :
            a = linear(interval2[0], interval2[1], tickness[1], tickness[2], curve_pts[i])
            print(a)
            tick.append(a)
        elif curve_pts[i]>=interval2[1]:
            tick.append(tickness[2])
# ---------- end python ----------
tick = ClusterOutput(python.tick)
panel = Panel(python.tick)

# ==== cluster Camber
crv = ClusterInput()
crv_2 = Curve(crv)
camber1 = Slider(0, range=0..0.2)
camber2 = Slider(0, range=0..0.2)
camber3 = Slider(0, range=0..0.2)
point_on_curve = PointOnCurve(crv_2, parameter=0)
curvepoint = PointOnCurve(crv_2, parameter=1)
point_on_curve_2 = PointOnCurve(crv_2, parameter=0)
point_on_curve_3 = PointOnCurve(crv_2, parameter=1)
point3 = Point(point_on_curve_3)
point1 = Point(point_on_curve)
point2 = Point(point_on_curve_2)
point4 = Point(curvepoint)
curve_pts = ClusterInput()
num = Number([camber1, camber2, camber3])
crv_cp = CurveClosestPoint(Point=[point1, point2, point3, point4], Curve=crv_2)  # -> Point, Parameter, Distance
python = GhPythonScript(pt_transi=crv_cp.Parameter, curve_pts=curve_pts, camber_value=num)  # -> out, camber; inputs pt_transi: list, curve_pts: list, camber_value: list
# ---------- python: Python ----------
import rhinoscriptsyntax as rs
camber = []
length = len(curve_pts)
ind = 0
curve_domain = [curve_pts[0], curve_pts[-1]]
curve_end = curve_pts[-1]

def linear(x1, x2, y1, y2, x):
    coef = (y2-y1)/(x2-x1)
    return y1 +coef*(x-x1)

interval1 = [pt_transi[0], pt_transi[1]]
interval2 = [pt_transi[2], pt_transi[3]]
if len(camber_value)==1:
    for i in curve_pts:
        camber.append(camber_value[0])
else:
    for i in range (0, length) :
        if curve_pts[i]<=interval1[0]:
            print(camber_value[0])
            camber.append(camber_value[0])
        elif interval1[0]<curve_pts[i]<interval1[1] :
            a = linear(interval1[0], interval1[1], camber_value[0], camber_value[1], curve_pts[i])
            print(a)
            camber.append(a)
        elif interval1[1]<=curve_pts[i]<=interval2[0] :
            camber.append(camber_value[1])
        elif interval2[0]<curve_pts[i]<interval2[1] :
            a = linear(interval2[0], interval2[1], camber_value[1], camber_value[2], curve_pts[i])
            print(a)
            camber.append(a)
        elif curve_pts[i]>=interval2[1]:
            camber.append(camber_value[2])
# ---------- end python ----------
camber = ClusterOutput(python.camber)
panel = Panel(python.camber)

# ==== cluster Chord_end
crv = ClusterInput()
crv_2 = Curve(crv)
curvepoint = PointOnCurve(crv_2, parameter=0.23)
pt = Point(curvepoint)
crv_cp = CurveClosestPoint(Point=pt, Curve=crv_2)  # -> Point, Parameter, Distance
y = ClusterInput()
python = GhPythonScript(x=crv_cp.Parameter, y=y)  # -> chord_1, chord_2, move1; inputs y: list
# ---------- python: Python ----------
import rhinoscriptsyntax as rs
chord_1 = []
chord_2 = []
move1 = []
for i in y:
    if i<x:
        chord_1.append(1)
        move1.append(0)
    else:
        chord_2.append(1)
# ---------- end python ----------
lng = ListLength(List=python.chord_2)
subtraction = Subtraction(A=lng, B=1)
range = Range(Domain=Domain(0, 3), Steps=subtraction)
graph = GraphMapper(range, x0=0, x1=3, y0=0, y1=1, container_name="Bezier", cpx=[0, 0.2641509473, 0.728333652, 1], cpy=[0, 0, 0, 0])
graph_2 = GraphMapper(range, x0=0, x1=3, y0=0, y1=1, container_name="Bezier", cpx=[0, 0.3162680864, 0.7201198339, 1], cpy=[1, 1, 1, 1])
addition = Addition(A=graph_2, B=Slider(0, range=0..5))
pt_2 = ConstructPoint(XCoordinate=range, YCoordinate=0, ZCoordinate=graph)
pt_3 = ConstructPoint(XCoordinate=range, YCoordinate=0, ZCoordinate=addition)
movetoplane = MoveToPlane(Geometry=pt_2, Plane=PlaneXY(0, 0, 0), Above=True, Below=True)  # -> Geometry, Transform
ln = Line(StartPoint=pt_2, EndPoint=pt_3)
ln_2 = Line(StartPoint=movetoplane.Geometry, EndPoint=pt_2)
chord = ClusterInput()
len = Length(Curve=ln_2)
len_2 = Length(Curve=ln)
python_2 = GhPythonScript(x=python.chord_1, y=len_2)  # -> chord; inputs x: list, y: list
# ---------- python_2: Python ----------
import rhinoscriptsyntax as rs
chord = x+y
# ---------- end python_2 ----------
python_3 = GhPythonScript(x=python.move1, y=len)  # -> move; inputs x: list, y: list
# ---------- python_3: Python ----------
import rhinoscriptsyntax as rs
move = x+y
# ---------- end python_3 ----------
X = UnitX(Factor=1)
rev = Reverse(Vector=X)
multiplication = Multiplication(Chord=chord, B=python_3)
multiplication_2 = Multiplication(Chord=chord, B=python_2)
panel = Panel(multiplication_2)
G = ClusterInput()
multiplication_3 = Multiplication(A=rev, B=multiplication)
multiplication_4 = Multiplication(A=multiplication, B=-1)
move = Move(Geometry=G, Motion=multiplication_3)  # -> Geometry, Transform
panel_2 = Panel(move.Geometry)
chord_2 = ClusterOutput(multiplication_2)
R = ClusterOutput(multiplication_4)
G_2 = ClusterOutput(move.Geometry)
nurbs = NurbsCurve(Vertices=move.Geometry, Degree=3, Periodic=False)  # -> Curve, Length, Domain

# ==== cluster Twist
crv = ClusterInput()
crv_2 = Curve(crv)
twist3 = Slider(0, range=0..90)
twist1 = Slider(0, range=0..90)
twist2 = Slider(0, range=0..90)
point_on_curve = PointOnCurve(crv_2, parameter=1)
point_on_curve_2 = PointOnCurve(crv_2, parameter=0)
point_on_curve_3 = PointOnCurve(crv_2, parameter=1)
point_on_curve_4 = PointOnCurve(crv_2, parameter=1)
point4 = Point(point_on_curve)
point3 = Point(point_on_curve_4)
curve_pts = ClusterInput()
point1 = Point(point_on_curve_2)
point2 = Point(point_on_curve_3)
num = Number([twist1, twist2, twist3])
crv_cp = CurveClosestPoint(Point=[point1, point2, point3, point4], Curve=crv_2)  # -> Point, Parameter, Distance
python = GhPythonScript(pt_transi=crv_cp.Parameter, curve_pts=curve_pts, twist_value=num)  # -> twist; inputs pt_transi: list, curve_pts: list, twist_value: list
# ---------- python: Python ----------
import rhinoscriptsyntax as rs
twist = []
length = len(curve_pts)
ind = 0
curve_domain = [curve_pts[0], curve_pts[-1]]
curve_end = curve_pts[-1]

def linear(x1, x2, y1, y2, x):
    coef = (y2-y1)/(x2-x1)
    return y1 +coef*(x-x1)

interval1 = [pt_transi[0], pt_transi[1]]
interval2 = [pt_transi[2], pt_transi[3]]
if len(twist_value)==1:
    for i in curve_pts:
        twist.append(twist_value[0])
else:
    for i in range (0, length) :
        if curve_pts[i]<=interval1[0]:
            print(twist_value[0])
            twist.append(twist_value[0])
        elif interval1[0]<curve_pts[i]<interval1[1] :
            a = linear(interval1[0], interval1[1], twist_value[0], twist_value[1], curve_pts[i])
            print(a)
            twist.append(a)
        elif interval1[1]<=curve_pts[i]<=interval2[0] :
            twist.append(twist_value[1])
        elif interval2[0]<curve_pts[i]<interval2[1] :
            a = linear(interval2[0], interval2[1], twist_value[1], twist_value[2], curve_pts[i])
            print(a)
            twist.append(a)
        elif curve_pts[i]>=interval2[1]:
            twist.append(twist_value[2])
# ---------- end python ----------
twist = ClusterOutput(python)
panel = Panel(python)

# ==== cluster New_profile
V = ClusterInput()
intcrv = Interpolate(Vertices=V, Degree=Slider(3, range=0..10), Periodic=False, KnotStyle=1)  # -> Curve, Length, Domain
box_section = GhPythonScript(x=intcrv.Curve)  # -> out, length, heigth, l_curve, h1, h2; inputs x: Curve
# ---------- box_section: Python ----------
import rhinoscriptsyntax as rs
box=rs.BoundingBox(x)

curve1 = rs.AddLine(box[0],box[1])
curve2 = rs.AddLine(box[1], box[2])

a = rs.Distance(box[0],box[1])

b = rs.Distance(box[1],box[2])


if a<b:
    length = b
    l_curve = curve2
    heigth = a
    h1 = curve1
    h2 = rs.AddLine(box[2], box[3])
else : 
    length = a
    l_curve = curve1
    heigth = b
    h1 = curve2
    h2 = rs.AddLine(box[3], box[0])
# ---------- end box_section ----------
N = ClusterInput()
arrcurve = CurveArray(Geometry=box_section.h2, Curve=box_section.l_curve, Count=N)  # -> Geometry, Transform
ccx = CurveCurve(CurveA=arrcurve.Geometry, CurveB=intcrv.Curve)  # -> flatten(Points), ParamsA, ParamsB
new_camber = ClusterInput()
python = GhPythonScript(x=ccx.Points)  # -> points, le_point, te_point; inputs x: list
# ---------- python: Python ----------
import rhinoscriptsyntax as rs
points = x[1:-1]
le_point = x[0]
te_point = x[-1]
# ---------- end python ----------
max_tickness = ClusterInput()
camber_cl__influence = Number(14)
cluster = Cluster(
    A=max_tickness,
    L=python.points,
    new_camber=new_camber,
    le_point=python.le_point,
    te_point=python.te_point,
    x=arrcurve.Geometry)  # -> extrados, intrados, middle_line, lift_center_3, chord_3
multiplication = Multiplication(A=new_camber, B=camber_cl__influence)
multiplication_2 = Multiplication(A=multiplication)
scaling = ClusterInput()
line = Line(cluster.chord_3)
camber_points = Point(cluster.middle_line)
extrados_points = Point(cluster.extrados)
intrados_points = Point(cluster.intrados)
scale = Scale(Geometry=line, Center=python.le_point, Scaling=scaling)  # -> Geometry, Transform
scale_2 = Scale(Geometry=cluster.lift_center_3, Center=python.le_point, Scaling=scaling)  # -> Lift_center, Transform
Y = UnitY(Factor=1)
python_2 = GhPythonScript(x=extrados_points, y=intrados_points, le_point=python.le_point, te_point=python.te_point)  # -> a; inputs x: list, y: list
# ---------- python_2: Python ----------
import rhinoscriptsyntax as rs
a = [te_point]
x.reverse()
length = len(x)
for i in x:
    a.append(i)
a.append(le_point)


for j in y:
    a.append(j)
a.append(te_point)
# ---------- end python_2 ----------
line_2 = LineSDL(Start=scale_2.Lift_center, Direction=Y, Length=multiplication_2)
intcrv_2 = Interpolate(Vertices=python_2, Degree=3, Periodic=False, KnotStyle=2)  # -> Curve, Length, Domain
panel = Panel(python_2)
scale_3 = Scale(Geometry=intcrv_2.Curve, Center=python.le_point, Scaling=scaling)  # -> Geometry, Transform
lift_vector = ClusterOutput(line_2)
lift_center = ClusterOutput(scale_2.Lift_center)
le_point = ClusterOutput(python.le_point)
section = ClusterOutput(scale_3.Geometry)
chord = ClusterOutput(scale.Geometry)

# ==== cluster Rotate_planes
i = ClusterInput()
series = Series(Start=0, Step=90, Count=4)
pln = ClusterInput()
item = ListItem(List=series, Index=i, Wrap=True)
pln_2 = Plane(pln)
rad = Radians(Degrees=item)
prot = RotatePlane(Plane=pln_2, Angle=rad)
P = ClusterOutput(prot)

# ==== cluster Shaft_angle
pt = ClusterInput()
pt_2 = Point(pt)
Y = UnitY(Factor=1)
D = ClusterInput()
rev = Reverse(Vector=Y)
rad = Radians(Degrees=D)
rot3d = Rotate3D(Geometry=pt_2, Angle=rad, Center=Point(0, 0, 0), Axis=Y)  # -> Geometry, Transform
pdecon = Deconstruct(Point=rot3d.Geometry)  # -> XComponent, YComponent, ZComponent
X = ClusterOutput(pdecon.XComponent)

# ==== cluster Origin_position
D = ClusterInput()
V = ClusterInput()
intcrv = Interpolate(Vertices=V, Degree=D, Periodic=False, KnotStyle=1)  # -> Curve, Length, Domain
box_section = GhPythonScript(x=intcrv.Curve)  # -> length, heigth, l_curve, h1, h2; inputs x: Curve
# ---------- box_section: Python ----------
__author__ = "maxim"
__version__ = "2023.02.28"

import rhinoscriptsyntax as rs
box=rs.BoundingBox(x)

curve1 = rs.AddLine(box[0],box[1])
curve2 = rs.AddLine(box[1], box[2])

a = rs.Distance(box[0],box[1])

b = rs.Distance(box[1],box[2])


if a<b:
    length = b
    l_curve = curve2
    heigth = a
    h1 = curve1
    h2 = rs.AddLine(box[2], box[3])
else : 
    length = a
    l_curve = curve1
    heigth = b
    h1 = curve2
    h2 = rs.AddLine(box[3], box[0])
# ---------- end box_section ----------
ccx = CurveCurve(CurveA=intcrv.Curve, CurveB=box_section.h2)  # -> Points, ParamsA, ParamsB
pt = ConstructPoint(XCoordinate=0, YCoordinate=0, ZCoordinate=0)
vec2pt = Vector2Pt(PointA=ccx.Points, PointB=pt, Unitize=False)  # -> Vector, Length
move = Move(Geometry=V, Motion=vec2pt.Vector)  # -> Geometry, Transform
G = ClusterOutput(move.Geometry)

# ==== cluster Cluster
le_point = ClusterInput()
te_point = ClusterInput()
X = UnitX(Factor=1)
le_point_2 = Point(le_point)
te_point_2 = Point(te_point)
L = ClusterInput()
chord = Line(StartPoint=le_point_2, EndPoint=te_point_2)
angle = Angle(VectorA=chord, VectorB=X)  # -> Angle, Reflex
dispatch = Dispatch(List=L, DispatchPattern=[True, False])  # -> Extrados_points, Intrados_points
x = ClusterInput()
deg = Degrees(Radians=angle.Angle)
python = GhPythonScript(x=x)  # -> a; inputs x: list
# ---------- python: Python ----------
import rhinoscriptsyntax as rs
a = x[1:-1]
# ---------- end python ----------
chord_2 = Line(chord)
len = Length(Curve=chord)
ln = Line(StartPoint=dispatch.Extrados_points, EndPoint=dispatch.Intrados_points)
chord_3 = ClusterOutput(chord_2)
ccx = CurveCurve(CurveA=chord, CurveB=python)  # -> flatten(Points), ParamsA, ParamsB
len_2 = Length(Curve=ln)
mid_point = CurveMiddle(Curve=ln)
lng = ListLength(List=ccx.Points)
num = Number(0.35)
python_2 = GhPythonScript(x=len_2)  # -> max_tickness, index; inputs x: list
# ---------- python_2: Python ----------
import rhinoscriptsyntax as rs
max_tickness = max(x)
index = x.index(max(x))
# ---------- end python_2 ----------
A = ClusterInput()
ln_2 = Line(StartPoint=mid_point, EndPoint=ccx.Points)
multiplication = Multiplication(A=lng, B=num)
len_3 = Length(Curve=ln_2)
factor = Division(A=A, B=python_2.max_tickness)
num_2 = Number(2)
panel = Panel(num_2)
lift_center = ListItem(List=ccx.Points, Index=multiplication, Wrap=True)
python_3 = GhPythonScript(x=len_3)  # -> max_camber, index; inputs x: list
# ---------- python_3: Python ----------
import rhinoscriptsyntax as rs
max_camber = max(x)
index = x.index(max(x))
# ---------- end python_3 ----------
division = Division(A=factor, B=num_2)
new_camber = ClusterInput()
lift_center_2 = Point(lift_center)
multiplication_2 = Multiplication(A=division, B=len_2)
lift_center_3 = ClusterOutput(lift_center_2)
camber_factor = Division(New_camber=new_camber, B=python_3.max_camber)
multiplication_3 = Multiplication(A=len_3, B=camber_factor)
subtraction = Subtraction(A=multiplication_3, B=len_3)
panel_2 = Panel(subtraction)
Y = UnitY(Factor=subtraction)
Y_2 = UnitY(Factor=multiplication_2)
rev = Reverse(Vector=Y_2)
move = Move(Geometry=mid_point, Motion=Y)  # -> Middle_line, Transform
move_2 = Move(Geometry=move.Middle_line, Motion=Y_2)  # -> Geometry, Transform
move_3 = Move(Geometry=move.Middle_line, Motion=rev)  # -> Geometry, Transform
middle_line = ClusterOutput(move.Middle_line)
intrados = ClusterOutput(move_3.Geometry)
extrados = ClusterOutput(move_2.Geometry)
